test file "Temp_Protection"
  coverage: Decision

suite "Simulaton Test"

  case "Temp Analysis" [simulation]
    description: Temperature Protection test using Simulation Test Mode in the test Suite
    model Temp_Protection, harness Temp_Protection_Harness1_SimulationTest
    logged signals "Signal Set 1": Output Conversion Subsystem:1, Output Conversion Subsystem:2, Output Conversion Subsystem:3, Output Conversion Subsystem:4, Output Conversion Subsystem:5

suite "Baseline Test"

  case "Temp_Protection_With_Differenr_temperatureInputs" [baseline]
    description: Temperature Protection test using Baseline Test Mode in the test Suite
    model Temp_Protection, harness Temp_Protection_Harness1_SimulationTest
    parameter set "Parameter Set 1": O_Temp = 40, U_Temp = 25  % base workspace
    parameter set "Parameter Set 2" (off):
      O_Temp = 40 (off)  % base workspace
    logged signals "Signal Set 1": OT_LED, M1, M2, M3, UT_LED
    baseline "time_temperature.mat"
      data'(:,2)
      data'(:,3)
      data'(:,4)
      data'(:,5)
      data'(:,6)
    baseline "OT_LED.mat"
      Constant:Value
      M1
      M2
      M3
      OT_LED
      UT_LED
    baseline "OT_LED_1.mat"
      Constant:Value
      M1
      M2
      M3
      OT_LED
      UT_LED
    baseline "UT_LED.mat"
      Constant:Value
      M1
      M2
      M3
      OT_LED
      UT_LED

suite "Equivalence Test"

  case "Thermal Protection Test" [equivalence]
    description: Temperature protection model of the model using Equivalence Test
    simulation 1:
      model Temp_Protection_Testing
      input "time_temperature.mat", mapped to T_Sense (active)
    simulation 2:
      model Temp_Protection_Testing, mode Software-in-the-Loop (SIL)
      input "time_temperature.mat", mapped to T_Sense (active)
    equivalence criteria
      T_M1:1
      T_M3:1
      T_M2:1
      OT_L:ED:1
      UT_LED:1